vi "AMCoherent.gvi"   [LabVIEW NXG 5.0.0]
inputs:
  "am_signal": waveform<f64> = {dt=1, Y=[]}
  "carrier_signal": waveform<f64> = {dt=1, Y=[]}
  "cutoff_freq": f64 = 0.125
  "order": i32 = 2
outputs:
  "am_coherent_demod_signal": waveform<f64>
  "am_coherent_demod_psd": T1
types:
  T1 = cluster{"f0": f64, "df": f64, "magnitude": f64[]}
uses:
  NI::Analysis::Filtering::Butterworth Lowpass Filter (Waveform).gvi
  NI::Analysis::Measurement::AC DC and RMS (single-shot)(Wfm).gvi
  NI::Analysis::Measurement::Power Spectral Density for 1 Chan.gvi
diagram:
  Waveform Multiply($am_signal, $carrier_signal) -> w1
  call "Butterworth Lowpass Filter (Waveform).gvi"(signal=w1, cutoff frequency=$cutoff_freq, order=$order) -> (filtered signal=w2)
  call "AC DC and RMS (single-shot)(Wfm).gvi"(signal=w2) -> (DC value=w3)
  Waveform Subtract(x=w2, y=w3) -> w4
  Waveform Multiply(w4, 2) -> w5
  $am_coherent_demod_signal <- w5
  call "Power Spectral Density for 1 Chan.gvi"(signal=w5) -> (power spectral density=w6)
  $am_coherent_demod_psd <- w6
