vi "FMDemodulator_2.gvi"   [LabVIEW NXG 5.0.0]
inputs:
  "fm_signal": waveform<f64> = {dt=1, Y=[]}
  "low_cutoff_freq": f64 = 0.125
  "order": i32 = 2
  "kf": f64
  "Ac": f64
outputs:
  "demod_signal": waveform<f64>
  "demod_psd": T1
  "filtered_signal": waveform<f64>
  "test": waveform<f64>
types:
  T1 = cluster{"f0": f64, "df": f64, "magnitude": f64[]}
uses:
  NI::Analysis::IntegralDifferentiation::Derivative x(t).gvi
  NI::Analysis::Filtering::Butterworth Lowpass Filter (Waveform).gvi
  NI::Analysis::Measurement::AC DC and RMS (single-shot)(Wfm).gvi
  NI::Analysis::Measurement::Power Spectral Density for 1 Chan.gvi
diagram:
  Property Node(instance in=$fm_signal) -> ("Y"=w1, "t0"=w2, "dt"=w3)
  call "Derivative x(t).gvi"(dt=w3, x(t)=w1) -> (dx(t)/dt=w4)
  Is Greater Or Equal To 0(x=w4) -> w5
  Boolean To 0 Or 1(Boolean=w5) -> (0, 1=w6)
  Multiply(w6, w4) -> w7
  Build Waveform Node(Y=w7, dt=w3, t0=w2) -> (output waveform=w8)
  $test <- w8
  call "Butterworth Lowpass Filter (Waveform).gvi"(signal=w8, cutoff frequency=$low_cutoff_freq, order=$order) -> (filtered signal=w9)
  call "AC DC and RMS (single-shot)(Wfm).gvi"(signal=w9) -> (DC value=w10)
  Waveform Subtract(x=w9, y=w10) -> w11
  Multiply($kf, $Ac) -> w12
  Multiply(w12, 1.9) -> w13
  Waveform Divide(x=w11, y=w13) -> w14
  call "Power Spectral Density for 1 Chan.gvi"(signal=w14) -> (power spectral density=w15)
  $demod_psd <- w15
  $filtered_signal <- w9
  $demod_signal <- w14
