vi "BPSK_Tx_Rx_Template.gvi"   [LabVIEW NXG 5.0.0]
panel controls:
  "IQ rate": f64 = 200000
  "device names": "USRP niUSRPClass"
  "carrier frequency": f64 = 400000000
  "gain Tx": f64
  "active antenna Tx": string = "TX1"
  "stop Tx": bool
  "gain Rx": f64
  "active antenna Rx": string = "RX2"
  "total bits": i32 = 128
panel indicators:
  "Baseband Waveform": waveform<c128>
  "Baseband Power Spectrum_Tx": T1
  "Baseband Power Spectrum_Rx": T1
  "output_bits": i16[]
  "BER": f64
  "trigger found?": bool
types:
  T1 = cluster{"f0": f64, "df": f64, "magnitude": f64[]}
uses:
  NI::USRP::niUSRP Open Rx Session.gvi
  NI::USRP::niUSRP Configure Signal.gvi
  NI::USRP::niUSRP Initiate.gvi
  NI::USRP::niUSRP Fetch Rx Data (CDB).gvi
  NI::USRP::niUSRP Close Session.gvi
  NI::Modulation::MT Generate Filter Coefficients.gvi
  NI::Analysis::Operations::1D Convolution (DBL).gvi
  NI::Analysis::Resampling::Decimate (single shot, DBL).gvi
  NI::Modulation::MT Calculate BER After Trigger (PN Sequence).gvi
  NI::USRP::niUSRP Open Tx Session.gvi
  NI::Modulation::MT Generate Bits (Galois, PN Order).gvi
  NI::Analysis::Resampling::Upsample (DBL).gvi
  NI::USRP::niUSRP Write Tx Data (CDB).gvi
diagram:
  # Transmitter
  # Receiver
  call "niUSRP Open Rx Session.gvi"(device names=$"device names") -> (session handle out=w1, error out=w2)
  call "niUSRP Configure Signal.gvi"(active antenna=$"active antenna Rx", session handle=w1, error in=w2, IQ rate=$"IQ rate", carrier frequency=$"carrier frequency", gain=$"gain Rx") -> (session handle out=w3, error out=w4, coerced carrier frequency=w5)
  Subtract(x=w5, y=20000) -> w6
  Property Node(instance in=w3, "niUSRP"=w6) -> (instance out=w7)
  call "niUSRP Initiate.gvi"(session handle=w7, error in=w4) -> (session handle out=w8, error out=w9)
  call "niUSRP Fetch Rx Data (CDB).gvi"(session handle=w8, error in=w9, number of samples=1000000) -> (session handle out=w10, error out=w11, data=w12)
  call "niUSRP Close Session.gvi"(session handle=w10, error in=w11)
  call "MT Generate Filter Coefficients.gvi"(pulse shaping filter="Root Raised Cos", matched samples per symbol=20, modulation type="PSK") -> (matched filter coefficients=w13)
  call "FrameSync (Complex).gvi"(Sampled Input=w12) -> (Aligned Samples=w14)
  call "Channel Estimator.gvi"(input signal=w14) -> (signal out=w15)
  Complex To Real And Imaginary(x + iy=w15) -> w16
  call "1D Convolution (DBL).gvi"(x=w16, y=w13) -> (x * y=w17)
  call "PulseAlign (Real).gvi"(Input signal=w17, Receiver Sampling Factor=20) -> (aligned output=w18)
  call "Decimate (single shot, DBL).gvi"(signal=w18, decimating factor=20) -> (decimated signal=w19)
  call "FrameSync (Real).gvi"(Sampled Input=w19) -> (Aligned Samples=w20)
  Array Size(array=w20) -> (size(s)=w21)
  s1 = uninitialised  # shift register
  for (N = w21) (iteration -> i1) {
    w22 = each element of w20
    Is Greater Than 0(x=w22) -> w23
    Insert Into Array(inArray=s1, index0=i1, new=w23) -> w24
    next s1 = w24
  }
  Boolean To 0 Or 1(Boolean=s1) -> (0, 1=w25)
  Array Subset(array=w25, index0=0, length0=$"total bits") -> w26
  $output_bits <- w26
  call "MT Calculate BER After Trigger (PN Sequence).gvi"(input bit stream=w26, BER trigger threshold=0.4) -> (BER=w27, trigger found?=w28)
  $BER <- w27
  call "niUSRP Open Tx Session.gvi"(device names=$"device names") -> (session handle out=w29, error out=w30)
  call "niUSRP Configure Signal.gvi"(active antenna=$"active antenna Tx", session handle=w29, error in=w30, IQ rate=$"IQ rate", carrier frequency=$"carrier frequency", gain=$"gain Tx") -> (session handle out=w31, error out=w32)
  call "MT Generate Bits (Galois, PN Order).gvi"(total bits=$"total bits") -> (output bit stream=w33)
  Array Size(array=w33) -> (size(s)=w34)
  s2 = uninitialised  # shift register
  for (N = w34) (iteration -> i2) {
    w35 = each element of w33
    Is Equal(x=w35, y=1) -> w36
    Select(s=w36, t=w35, f=-1) -> w37
    Insert Into Array(inArray=s2, index0=i2, new=w37) -> w38
    next s2 = w38
  }
  To Double Precision Float(number=s2) -> w39
  call "AddFrameHeader.gvi"(array=w39) -> (output array=w40)
  call "Upsample (DBL).gvi"(signal=w40, upsampling factor=20) -> (upsampled signal=w41)
  call "MT Generate Filter Coefficients.gvi"(pulse shaping filter="Root Raised Cos", pulse shaping samples per symbol=20, modulation type="PSK") -> (pulse shaping filter coefficients=w42)
  call "1D Convolution (DBL).gvi"(x=w41, y=w42) -> (x * y=w43)
  call "Quick Scale 1D.gvi"(X=w43) -> (Y[i]=X[i]/Max|X|=w44)
  Real And Imaginary To Complex(x=w44, y=0) -> w45
  Build Waveform Node(Y=w45, dt=5e-06) -> (output waveform=w46)
  call "Insert Pilots.gvi"(signal input=w46) -> (output signal=w47)
  call "AddFrameHeader (complex).gvi"(array=w47) -> (output array=w48)
  while {
    call "niUSRP Write Tx Data (CDB).gvi"(session handle=w31, error in=w32, data=w48) -> (session handle out=w49, error out=w50)
    stop if $"stop Tx"
  }
  call "niUSRP Close Session.gvi"(session handle=w49, error in=w50)
  $"trigger found?" <- w28
  w51 = cluster{"t0": timestamp, "dt": f64, "Y": c128[]} {all zero or empty}
  Property Node(instance in=w51, "dt"=5e-06, "Y"=w17) -> (instance out=w52)
  call "FFT Power Spectrum for 1 Chan (CDB)2.gvi"(time signal=w52, dB On (F)=TRUE) -> (power spectrum=w53)
  $"Baseband Power Spectrum_Rx" <- w53
  $"Baseband Waveform" <- w46
  w54 = cluster{"t0": timestamp, "dt": f64, "Y": c128[]} {all zero or empty}
  Property Node(instance in=w54, "dt"=5e-06, "Y"=w45) -> (instance out=w55)
  call "FFT Power Spectrum for 1 Chan (CDB)2.gvi"(time signal=w55, dB On (F)=TRUE) -> (power spectrum=w56)
  $"Baseband Power Spectrum_Tx" <- w56
